# Dynamo graph Example.dyn (Dynamo 2.5.0.7460)

# group: Circle Circle Fitting
byCoordinates = Point.ByCoordinates()
byCenterPointRadius = Circle.ByCenterPointRadius(centerPoint=byCoordinates)
code_block = CodeBlock { 0; 0.1; 0; }
byCoordinates_2 = Point.ByCoordinates(x=code_block.out0, y=code_block.out1, z=code_block.out2)
code_block_2 = CodeBlock { 1.2; }
byCenterPointRadius_2 = Circle.ByCenterPointRadius(centerPoint=byCoordinates_2, radius=code_block_2)
code_block_3 = CodeBlock { 0.01; 0.01; }
byCircleAndCircle = Dynamoid.Clothoid.ByCircleAndCircle(circleStart=byCenterPointRadius, circleEnd=byCenterPointRadius_2, stepsize=code_block_3.out0, tolerance=code_block_3.out1)

# group: Cirlce Line Fitting
code_block_4 = CodeBlock { 0; 3; 0; }
byCoordinates_3 = Point.ByCoordinates(x=code_block_4.out0, y=code_block_4.out1, z=code_block_4.out2)
byCenterPointRadius_3 = Circle.ByCenterPointRadius(centerPoint=byCoordinates_3)
code_block_5 = CodeBlock { 2; 3; 0; }
byCoordinates_4 = Point.ByCoordinates(x=code_block_5.out0, y=code_block_5.out1, z=code_block_5.out2)
code_block_6 = CodeBlock { 4; 5; 0; }
byCoordinates_5 = Point.ByCoordinates(x=code_block_6.out0, y=code_block_6.out1, z=code_block_6.out2)
byStartPointEndPoint = Line.ByStartPointEndPoint(startPoint=byCoordinates_4, endPoint=byCoordinates_5)
boolean = BoolSelector(true)
code_block_7 = CodeBlock { 0.01; 0.01; }
byLineAndCircle = Dynamoid.Clothoid.ByLineAndCircle(circle=byCenterPointRadius_3, line=byStartPointEndPoint, fromLineToCircle=boolean, stepsize=code_block_7.out0, tolerance=code_block_7.out1)
